# Grasshopper definition StencilGeneratorFromLoft Surface.gh (Grasshopper 1.0.8)

# ---- group: Loft length
num = Number(Slider(679, range=0..1000))

# ---- group: spacing distance
int = Integer(Slider(43, range=0..110))

# ---- group: curve 1
# Stencil Generator From Loft  Surface
crv = Curve(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)

# ---- group: curve 2
crv_2 = Curve(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)

# ---- group: Length X- axis
int_2 = Integer("500")

# ---- group: curve 2
crv_3 = Curve(crv_2)

# ---- group: length
num_2 = Number(num)

# ---- group: spacing distance
int_3 = Integer(int)

# ---- group: curve 1
crv_4 = Curve(crv)

# ---- group: length
num_3 = Number(num)

# ---- group: Length X- axis
int_4 = Integer(int_2)

# ---- group: curve 1
# Generate weaving draft frame
crv_5 = Curve(crv)

# Generate loft
crv_6 = Curve(crv_5)

# Geometry preview
crv_7 = Curve(crv_5)

# ---- group: stancil height
num_4 = Number("100")

# ---- group: length
num_5 = Number(num)

# ---- group: spacing distance
int_5 = Integer(int)

# ---- group: Length X- axis
int_6 = Integer(int_2)

# ----
end = EndPoints(Curve=crv_4)  # -> Start, End
Y = UnitY(Factor=1)
end_2 = EndPoints(Curve=crv_5)  # -> Start, End
division = Division(A=num_5, B=int_5)
Y_2 = UnitY(Factor=num_2)
ln = Line(StartPoint=end.Start, EndPoint=end.End)
ln_2 = Line(StartPoint=end_2.Start, EndPoint=end_2.End)
round = Round(Number=division)  # -> Nearest, Floor, Ceiling
move = Move(Geometry=crv_3, Motion=Y_2)  # -> Geometry, Transform
X = UnitX(Factor="20")
midpt = CurveMiddle(Curve=ln_2)
end_3 = EndPoints(Curve=ln)  # -> Start, End
merge = Merge(Data1=crv_4, Data2=ln)
division_2 = Division(A=num_5, B=round.Ceiling)

# ---- group: curve 1 middle
pt = Point(midpt)

# ---- group: Length X- axis
int_7 = Integer("500")

# ---- group: curve 1 middle
pt_2 = Point(midpt)

# ---- group: Length X- axis
int_8 = Integer("500")

# ----
join = JoinCurves(Curves=merge, Preserve=False)
X_2 = UnitX(Factor=1)
series = Series(Start=0, Step=division_2, Count=division)
X_3 = UnitX(Factor="10")
Y_3 = UnitY(Factor="10")
cluster = Cluster(crv=move.Geometry, pt=pt, num=int_7)
cluster_2 = Cluster(crv=crv_6, pt=pt, num=int_7)
neg = Negative(Value=X_2)
cluster_3 = Cluster(crv=crv_5, pt=pt_2, num=int_8)
addition = Addition(A=X_3, B=Y_3)
addition_2 = Addition(A=series, B=int_5)
padjust = AdjustPlane(Plane=end_3.Start, Normal=neg)
rad = Radians(Degrees="90")
merge_2 = Merge(Data1=cluster_2, Data2=cluster)
dom = ConstructDomain(DomainStart=0, DomainEnd=num_3)
dom_2 = ConstructDomain(DomainStart="0", DomainEnd="4")

# ---- group: first curve full length
curve = Curve(cluster_3)

# ----
dom_3 = ConstructDomain(DomainStart=series, DomainEnd=addition_2)
rotate = Rotate(Geometry=join, Angle=rad, Plane=padjust)  # -> Geometry, Transform
loft = Loft(Curves=merge_2, Options={Adjust=False, Closed=False, LoftEnds=0, LoftSimp=0, LoftType=0, Rebuild=10, Refit=0.01})
end_4 = EndPoints(Curve=curve)  # -> Start, End
xy = XYPlane(Origin=Point(0, 0, 0))
bbox = BoundingBox(Content=rotate.Geometry, Plane=PlaneXY(0, 0, 0))  # -> Box, Box_2

# ---- group: Loft surface
brep = Brep(loft)

# Generate contours
brep_2 = Brep(brep)

# ----
contour = Contour(Shape=brep_2, Point=Point(0, 0, 0), Direction=Y, Distance=int_3)

end_5 = EndPoints(Curve=crv_7)  # -> Start, End
ln_3 = Line(StartPoint=end_5.Start, EndPoint=end_5.End)
merge_3 = Merge(Data1=crv_7, Data2=ln_3)
join_2 = JoinCurves(Curves=merge_3, Preserve=False)
boundary = BoundarySurfaces(Edges=join_2)
merge_4 = Merge(Data1=brep, Data2=boundary)
material = CreateMaterial(
    Diffuse=ColourSwatch(SwatchColor=RGB(255, 219, 255)),
    Specular=ColourSwatch(SwatchColor=RGB(71, 61, 71)),
    Emission=ColourSwatch(SwatchColor=RGB(76, 14, 76)),
    Transparency=0,
    Shine=0)

# ---- group: Rotate 90 degrees
end_6 = EndPoints(Curve=contour)  # -> Start, End
pln = Plane(end_6.Start)
X_4 = UnitX(Factor=1)
neg_2 = Negative(Value=X_4)
rad_2 = Radians(Degrees="90")
padjust_2 = AdjustPlane(Plane=pln, Normal=neg_2)
rotate_2 = Rotate(Geometry=contour, Angle=rad_2, Plane=padjust_2)  # -> Geometry, Transform

# ---- group: curve 1 rotated
curve_2 = Curve(rotate.Geometry)

# ---- group: contour lines
crv_8 = Curve(rotate_2.Geometry)

# Generate stencils
crv_9 = Curve(crv_8)

# ----
end_7 = EndPoints(Curve=crv_9)  # -> Start, End
pdecon = Deconstruct(Point=end_7.End)  # -> XComponent, YComponent, ZComponent
pdecon_2 = Deconstruct(Point=end_7.Start)  # -> XComponent, YComponent, ZComponent
addition_3 = Addition(A=pdecon_2.YComponent, B=num_4)
addition_4 = Addition(A=pdecon.YComponent, B=num_4)
pt_3 = ConstructPoint(XCoordinate=pdecon_2.XComponent, YCoordinate=addition_3, ZCoordinate=0)
pt_4 = ConstructPoint(XCoordinate=pdecon.XComponent, YCoordinate=addition_4, ZCoordinate=0)
merge_5 = Merge(Data1=end_7.Start, Data2=pt_3, Data3=pt_4, Data4=end_7.End)
pline = PolyLine(Vertices=merge_5, Closed=False)
merge_6 = Merge(Data1=crv_9, Data2=pline)
dom_4 = ConstructDomain(DomainStart="-4", DomainEnd="0")
dom_5 = ConstructDomain(DomainStart="-4", DomainEnd="-30")
xy_2 = XYPlane(Origin=Point(0, 0, 0))

# ---- group: first curve full length- start
point = Point(end_4.Start)

point_2 = Point(point)

point_3 = Point(point)

# ----
pdecon_3 = Deconstruct(Point=point_2)  # -> XComponent, YComponent, ZComponent
pdecon_4 = Deconstruct(Point=point_3)  # -> XComponent, YComponent, ZComponent

# ---- group: bottom left pos - x
num_6 = Number(pdecon_3.XComponent)

num_7 = Number(pdecon_4.XComponent)

# ----
addition_5 = Addition(A=int_4, B=num_6)
dom_6 = ConstructDomain(DomainStart=num_6, DomainEnd=addition_5)
addition_6 = Addition(A=num_7, B=int_6)
rectangle = Rectangle(Plane=PlaneXY(0, 0, 0), XSize=dom_6, YSize=dom, Radius=0)  # -> Rectangle, Length
rectangle_2 = Rectangle(Plane=PlaneXY(0, 0, 0), XSize=dom_6, YSize=dom_2, Radius=0)  # -> Rectangle, Length
dom_7 = ConstructDomain(DomainStart=num_7, DomainEnd=addition_6)

# ---- group: first curve full length- end
point_4 = Point(end_4.End)

point_5 = Point(point_4)

# ----
addition_7 = Addition(A=point_5, B=X)
dom_8 = ConstructDomain(DomainStart=point_5, DomainEnd=addition_7)
rectangle_3 = Rectangle(Plane=xy, XSize=dom_8, YSize=dom_3, Radius=0)  # -> Rectangle, Length
addition_8 = Addition(A=num_4, B="2")
merge_7 = Merge(Data1=rectangle_2.Rectangle, Data2=rectangle.Rectangle)
drec = DeconstuctRectangle(Rectangle=bbox.Box)  # -> BasePlane, XInterval, YInterval
join_3 = JoinCurves(Curves=merge_6, Preserve=xy_2)
pcen = PolygonCenter(Polyline=rectangle_3.Rectangle)  # -> CenterV, CenterE, CenterA
rectangle_4 = Rectangle(Plane=PlaneXY(0, 0, 0), XSize=dom_7, YSize=dom_4, Radius=0)  # -> Rectangle, Length
rectangle_5 = Rectangle(Plane=PlaneXY(0, 0, 0), XSize=dom_7, YSize=dom_5, Radius=0)  # -> Rectangle, Length
dedomain = DeconstructDomain(Domain=drec.YInterval)  # -> Start, End
lng = ListLength(List=flatten(join_3))

# ---- group: Length X- axis
int_9 = Integer(int_2)

# ----
subtraction = Subtraction(A=dedomain.End, B=dedomain.Start)
cluster_4 = Cluster_2(pt=pcen.CenterV, L=rectangle_3.Rectangle, srf=rectangle_3.Rectangle)
series_2 = Series(Start=0, Step=addition_8, Count=lng)
addition_9 = Addition(A="700", B=int_9)
addition_10 = Addition(A=subtraction, B="4")
Y_4 = UnitY(Factor=series_2)
X_5 = UnitX(Factor=addition_9)
Y_5 = UnitY(Factor=addition_10)
addition_11 = Addition(A=Y_4, B=X_5)
merge_8 = Merge(Data1=cluster_4, Data2=rectangle_3.Rectangle)
move_2 = Move(Geometry=join_3, Motion=graft(addition_11))  # -> Geometry, Transform
move_3 = Move(Geometry=merge_7, Motion=Y_5)  # -> Geometry, Transform
move_4 = Move(Geometry=merge_8, Motion=Y_5)  # -> Geometry, Transform
preview = CustomPreview(Geometry=merge_4, Material=material)

# ---- group: stencilts marks
geometry = Geometry(move_4.Geometry)

# ---- group: draft frame
curve_3 = Curve(move_3.Geometry)

# ---- group: fold/twill
curve_4 = Curve(rectangle_4.Rectangle)

# ---- group: start
curve_5 = Curve(rectangle_5.Rectangle)

# ---- group: stencils
curve_6 = Curve(move_2.Geometry)

# Generate stencils Numbers
curve_7 = Curve(curve_6)

# ----
trim = TrimTree(Tree=curve_7, Depth="2")
index = ItemIndex(List=trim, Item=trim)
explode = Explode(Curve=trim, Recursive=True)  # -> Segments, Vertices
item = ListItem(List=explode.Vertices, Index="2", Wrap=True)
boundary_2 = BoundarySurfaces(Edges=curve_7)
addition_12 = Addition(A=item, B=addition)
trim_2 = TrimTree(Tree=boundary_2, Depth=1)
trim_3 = TrimTree(Tree=addition_12, Depth=1)
rectangle_6 = Rectangle(Plane=trim_3, XSize=Domain(-1, 1), YSize=Domain(-2, 2), Radius=0)  # -> Rectangle, Length
cluster_5 = Cluster_2(pt=trim_3, L=index, srf=rectangle_6.Rectangle)
brep_3 = Brep(cluster_5)
edges = BrepEdges(Brep=brep_3)  # -> Naked, Interior, NonManifold

# ---- group: Stencils
crv_10 = Curve(curve_7)

# ---- group: Stencil numbers
crv_11 = Curve(edges.Interior)

# ---- group: curve 1 rotated
curve_8 = Curve(curve_2)

# ---- group: fold/twill
curve_9 = Curve(curve_4)

# ---- group: start
curve_10 = Curve(curve_5)

# ----
merge_9 = Merge(Data1=curve_3, Data2=curve_8, Data3=curve_9, Data4=curve_10)

# ---- group: stencilts marks
geometry_2 = Geometry(geometry)

# ----
X_6 = UnitX(Factor=Slider(580, range=0..1000))
move_5 = Move(Geometry=merge_9, Motion=X_6)  # -> Geometry, Transform
move_6 = Move(Geometry=geometry_2, Motion=X_6)  # -> Geometry, Transform
merge_10 = Merge(Data1=move_6.Geometry, Data2=move_5.Geometry)

# ---- group: weaving draft frame
geo = Geometry(merge_10)

# ==== cluster Cluster
pt = ClusterInput()
crv = ClusterInput()
pt_2 = Point(pt)
crv_2 = Curve(crv)
num = ClusterInput()
end = EndPoints(Curve=crv_2)  # -> Start, End
pdecon = Deconstruct(Point=pt_2)  # -> XComponent, YComponent, ZComponent
pdecon_2 = Deconstruct(Point=end.End)  # -> XComponent, YComponent, ZComponent
num_2 = Number(num)
pt_3 = ConstructPoint(XCoordinate=pdecon.XComponent, YCoordinate=pdecon_2.YComponent, ZCoordinate=0)
pdecon_3 = Deconstruct(Point=pt_3)  # -> XComponent, YComponent, ZComponent
division = Division(A=num_2, B="2")
addition = Addition(A=pdecon_3.XComponent, B=division)
subtraction = Subtraction(A=pdecon_3.XComponent, B=division)
pt_4 = ConstructPoint(XCoordinate=subtraction, YCoordinate=pdecon_3.YComponent, ZCoordinate=pdecon_3.ZComponent)
pt_5 = ConstructPoint(XCoordinate=addition, YCoordinate=pdecon_3.YComponent, ZCoordinate=pdecon_3.ZComponent)
end_2 = EndPoints(Curve=crv_2)  # -> Start, End
pt_6 = ConstructPoint(XCoordinate=pt_4, YCoordinate=0, ZCoordinate=0)
ln = Line(StartPoint=end_2.Start, EndPoint=pt_4)
ln_2 = Line(StartPoint=end_2.End, EndPoint=pt_5)
merge = Merge(Data1=ln, Data2=crv_2, Data3=ln_2)
join = JoinCurves(Curves=merge, Preserve=False)
crv_3 = Curve(join)
crv_4 = ClusterOutput(crv_3)

# ==== cluster Cluster_2
pt = ClusterInput()
pt_2 = Point(pt)
X = UnitX(Factor=Slider(6, range=0..10))
L = ClusterInput()
subtraction = Subtraction(A=pt_2, B=X)
addition = Addition(A=pt_2, B=X)
index = ItemIndex(List=L, Item=L)
ln = Line(StartPoint=subtraction, EndPoint=addition)
srf = ClusterInput()
srf_2 = Surface(srf)
textsrf = TextOnSurface(Text=index, Font="Sans Bold:no Italic:no", Height=Slider(10, range=0..100), Depth=0.4, BaseLine=ln, BaseSurface=srf_2)
brep = Brep(textsrf)
brep_2 = ClusterOutput(brep)
